# Grasshopper definition CSDI_Grasshopper intro (2) (1) (1) (1) (1) (1) (1) (1) (1) (1) (1).gh (Grasshopper 1.0.7)

# ---- group: expression
expression = Expression(Variable_x=Slider(-5, range=-10..10), Variable_y=Slider(3, range=-10..10), Expression="x*y+2*x")
panel = Panel(expression)

# ---- group: multiplication
# Math
panel_2 = Panel("5")
negative = Negative(Value=Slider(4, range=-10..10))
multiplication = Multiplication(A=panel_2, B=negative)
panel_3 = Panel(multiplication)

# ---- group: create a vector
vector_xyz = VectorXYZ(XComponent=Slider(5, range=-10..10), YComponent=Slider(3, range=-10..10), ZComponent=0)  # -> Vector, Length
point = Point(<point referenced from the Rhino model>)
vector_display = VectorDisplay(Anchor=point, Vector=vector_xyz.Vector)

# ---- group: unit vector
unit_x = UnitX(Factor=1)
point_2 = Point(<point referenced from the Rhino model>)
vector_display_2 = VectorDisplay(Anchor=point_2, Vector=unit_x)

# ---- group: create a line from a point and a vector
vector_xyz_2 = VectorXYZ(XComponent=Slider(5, range=-10..10), YComponent=Slider(3, range=-10..10), ZComponent=0)  # -> Vector, Length
point_3 = Point(<point referenced from the Rhino model>)
line_sdl = LineSDL(Start=point_3, Direction=vector_xyz_2.Vector, Length=vector_xyz_2.Length)

# ---- group: intersection of two lines
line = Line(Line((36, 43, 0), (55, 31, 0)))
line_2 = Line(Line((17, 29, 0), (41, 36, 0)))
line_line = LineLine(Line1=line_2, Line2=line)  # -> ParamA, ParamB, PointA, PointB

# ---- group: create a point
# Geometry
number_slider = Slider(5, range=-10..10)
construct_point = ConstructPoint(XCoordinate=number_slider, YCoordinate=Slider(3, range=-10..10), ZCoordinate=0)

# ---- group: intersection of line and curve
curve = Curve(<curve referenced from the Rhino model>)
line_3 = Line(Line((51, 17, 0), (62, 14, 0)))
rotate = Rotate(Geometry=line_3, Angle=degrees(Slider(0, range=0..360)), Plane=PlaneXY(0, 0, 0))  # -> Geometry, Transform
curve_line = CurveLine(Curve=curve, Line=rotate.Geometry)  # -> Points, Params, Count
panel_4 = Panel(curve_line.Points)

# ---- group: create a line from two points
point_4 = Point(<point referenced from the Rhino model>)
point_5 = Point(<point referenced from the Rhino model>)
line_4 = Line(StartPoint=point_4, EndPoint=point_5)

# ---- group: move a vector
# Move, rotate, scale
number_slider_2 = Slider(3, range=-10..10)
vector_xyz_3 = VectorXYZ(XComponent=number_slider_2, YComponent=Slider(3, range=-10..10), ZComponent=0)  # -> Vector, Length
point_6 = Point(<point referenced from the Rhino model>)
move = Move(Geometry=point_6, Motion=vector_xyz_3.Vector)  # -> Geometry, Transform

# ---- group: rotate a vector
vector_xyz_4 = VectorXYZ(XComponent=Slider(3, range=-10..10), YComponent=Slider(3, range=-10..10), ZComponent=0)  # -> Vector, Length
unit_z = UnitZ(Factor=1)
rotate_2 = Rotate(Vector=vector_xyz_4.Vector, Axis=unit_z, Angle=degrees(Slider(84, range=0..180)))
point_7 = Point(<point referenced from the Rhino model>)
vector_display_3 = VectorDisplay(Anchor=point_7, Vector=rotate_2)

# ---- group: scale a unit vector
unit_x_2 = UnitX(Factor=Slider(4, range=-10..10))
point_8 = Point(<point referenced from the Rhino model>)
vector_display_4 = VectorDisplay(Anchor=point_8, Vector=unit_x_2)

# ---- group: scale a vector with multiplication
vector_xyz_5 = VectorXYZ(XComponent=Slider(3, range=-10..10), YComponent=Slider(3, range=-10..10), ZComponent=0)  # -> Vector, Length
multiplication_2 = Multiplication(A=vector_xyz_5.Vector, B=Slider(2, range=-10..10))
point_9 = Point(<point referenced from the Rhino model>)
vector_display_5 = VectorDisplay(Anchor=point_9, Vector=multiplication_2)

# ---- group: merge two lists
curve_2 = Curve(<curve referenced from the Rhino model>)
curve_3 = Curve(<curve referenced from the Rhino model>)
divide_curve = DivideCurve(Curve=curve_2, Count=4, Kinks=False)  # -> Points, Tangents, Parameters
divide_curve_2 = DivideCurve(Curve=curve_3, Count=4, Kinks=False)  # -> Points, Tangents, Parameters
panel_5 = Panel(divide_curve.Points)
panel_6 = Panel(divide_curve_2.Points)
merge = Merge(Data1=panel_5, Data2=panel_6)
panel_7 = Panel(merge)

# ---- group: list
# Data structures
curve_4 = Curve(<curve referenced from the Rhino model>)
divide_curve_3 = DivideCurve(Curve=curve_4, Count=4, Kinks=False)  # -> Points, Tangents, Parameters
panel_8 = Panel(divide_curve_3.Points)

# ---- group: getting a specific item from a list
curve_5 = Curve(<curve referenced from the Rhino model>)
divide_curve_4 = DivideCurve(Curve=curve_5, Count=4, Kinks=False)  # -> Points, Tangents, Parameters
panel_9 = Panel(divide_curve_4.Points)
list_item = ListItem(List=panel_9, Index=Slider(3, range=0..4), Wrap=True)
panel_10 = Panel(list_item)

# ---- group: logical operator
curve_6 = Curve(<curve referenced from the Rhino model>)
divide_curve_5 = DivideCurve(Curve=curve_6, Count=4, Kinks=False)  # -> Points, Tangents, Parameters
panel_11 = Panel(divide_curve_5.Points)
deconstruct = Deconstruct(Point=panel_11)  # -> XComponent, YComponent, ZComponent
smaller_than = SmallerThan(FirstNumber=deconstruct.YComponent, SecondNumber=0)  # -> SmallerThan, OrEqualTo
panel_12 = Panel(smaller_than.SmallerThan)
dispatch = Dispatch(List=panel_11, DispatchPattern=panel_12)  # -> ListA, ListB
panel_13 = Panel(dispatch.ListA)
panel_14 = Panel(dispatch.ListB)

# ---- group: list of lists (tree)
curve_7 = Curve(<curve referenced from the Rhino model>)
curve_8 = Curve(<curve referenced from the Rhino model>)
divide_curve_6 = DivideCurve(Curve=curve_7, Count=4, Kinks=False)  # -> Points, Tangents, Parameters
divide_curve_7 = DivideCurve(Curve=curve_8, Count=4, Kinks=False)  # -> Points, Tangents, Parameters
panel_15 = Panel(divide_curve_6.Points)
panel_16 = Panel(divide_curve_7.Points)
entwine = Entwine(Branch00=panel_15, Branch01=panel_16, FlattenInputs=True)
panel_17 = Panel(entwine)

# ---- group: extracting one list from a list of lists
curve_9 = Curve(<curve referenced from the Rhino model>)
curve_10 = Curve(<curve referenced from the Rhino model>)
divide_curve_8 = DivideCurve(Curve=curve_9, Count=4, Kinks=False)  # -> Points, Tangents, Parameters
divide_curve_9 = DivideCurve(Curve=curve_10, Count=4, Kinks=False)  # -> Points, Tangents, Parameters
panel_18 = Panel(divide_curve_8.Points)
panel_19 = Panel(divide_curve_9.Points)
entwine_2 = Entwine(Branch00=panel_18, Branch01=panel_19, FlattenInputs=True)
panel_20 = Panel(entwine_2)
tree_branch = TreeBranch(Tree=panel_20, Path="{0;1}", MaintainPaths=True)
panel_21 = Panel(tree_branch)
