# Grasshopper definition CSDI_III_exercise1_solution.gh (Grasshopper 1.0.7)

task_1 = GhPythonScript()  # -> a
# ---------- task_1: Python ----------
__author__ = "elluis"
__version__ = "2022.11.05"

import rhinoscriptsyntax as rs

"""
Task 1: loop
Create an algorithm using a for loop that generates the following list: [7, 14, 21, 28, 35, 42, 49, 56, 63, 70]. 
"""

L=[]
for i in range (1,11):
    L.append(i*7)

print L
# ---------- end task_1 ----------
task_2 = GhPythonScript()  # -> a
# ---------- task_2: Python ----------
__author__ = "elluis"
__version__ = "2022.11.05"

import rhinoscriptsyntax as rs

"""
Task 2: loop and conditional
Given the following list L1=[[5,3],[0,3],[0,7],[6,-6],[10,-3],[11,8],[6,0],[1,1]], create a new list (L2) only with the lists from L1 if the two items add up to 7 or more than 7. 
For example: item "[5,3]", 5+3 >= 7, so this list is good!
"""

L1=[[5,3],[0,3],[0,7],[6,-6],[10,-3],[11,8],[6,0],[1,1]]
L2=[]

for i in range (0,len(L1)):
    if L1[i][0]+L1[i][1]>=7:
        L2.append(L1[i])
print L2
# ---------- end task_2 ----------
task_3 = GhPythonScript()  # -> a
# ---------- task_3: Python ----------
__author__ = "elluis"
__version__ = "2022.11.05"

import rhinoscriptsyntax as rs

"""
Task 3: geometry
Create an algorithm that draws a spiral in 2D. To do this create a for loop that adds a point, rotates it around [0,0,0] and stores it in a list. 
After, outside the for loop, use rs.AddPolyline to create a polyline connecting the spiral dots. 
"""

Lp=[]
a=0
for i in range (0,100):
    p=rs.AddPoint([i,0,0])
    p_rot=rs.RotateObject(p,[0,0,0],a)
    a=a+10
    Lp.append(p_rot)

a=rs.AddPolyline(Lp)
# ---------- end task_3 ----------
