# Grasshopper definition CSDI_III_tutorial.gh (Grasshopper 1.0.7)

# ---- group: anchor F2
pt = Point(<point referenced from the Rhino model>)  # disabled

# ---- group: anchor F1
pt_2 = Point(<point referenced from the Rhino model>)  # disabled

# ----
# 1.a Input loads
number_slider = Slider(-12, range=-50..50)  # disabled
number_slider_2 = Slider(-7, range=-50..50)  # disabled
unit_y = UnitY(Factor=number_slider)  # disabled
unit_y_2 = UnitY(Factor=number_slider_2)  # disabled
vector_display = VectorDisplay(Anchor=pt, Vector=unit_y)  # disabled
vector_display_2 = VectorDisplay(Anchor=pt_2, Vector=unit_y_2)  # disabled
f2 = Vector(unit_y)  # disabled
f1 = Vector(unit_y_2)  # disabled
line = LineSDL(Start=pt, Direction=f2, Length=1)  # disabled
line_2 = LineSDL(Start=pt_2, Direction=f1, Length=1)  # disabled
loa_f1 = Line(line_2)  # disabled
loa_f2 = Line(line)  # disabled

n1 = Slider(-10, range=-20..-1)
n2 = Slider(-10, range=-20..-1)

# ---- group: anchors
p1 = Point(<point referenced from the Rhino model>)
p2 = Point(<point referenced from the Rhino model>)

# ----
_1_a_input_loads = GhPythonScript(p1=p1, p2=p2, n1=n1, n2=n2)  # -> Lp_anc, Lv_load, Ll_LOA
# ---------- _1_a_input_loads: Python ----------
__author__ = "elluis"
__version__ = "2022.07.27"

import rhinoscriptsyntax as rs

#1.a INPUT LOADS

#input
Lp_anc=[p1,p2]
Ln_mag=[n1,n2]

#vector loads
Lv_load=[]
for i in range (0,len(Lp_anc)):
    v=[0,Ln_mag[i],0]
    Lv_load.append(v)

#LOA (Line Of Action)
Ll_LOA=[]
for i in range (0,len(Lp_anc)):
    p=rs.CopyObject(Lp_anc[i])
    rs.MoveObject(p,[0,-10,0])
    LOA=rs.AddLine(Lp_anc[i],p)
    Ll_LOA.append(LOA)
# ---------- end _1_a_input_loads ----------

# ---- group: first point force diagram
pt_3 = Point(Point(47.8759884, 19.00982651, 0))  # disabled

# ---- group: I'm random!
_0 = Point(<point referenced from the Rhino model>)  # disabled

# ---- group: first point force diagram
pt_4 = Point(<point referenced from the Rhino model>)

# ---- group: random pole
o1 = Point(<point referenced from the Rhino model>)

# ----
_1_b_resultant_force_diagram = GhPythonScript(Lv_load=_1_a_input_loads.Lv_load, X=pt_4, O1=o1)  # -> Lp_loadline, Ll_loadline, Lal_force; inputs Lv_load: list
# ---------- _1_b_resultant_force_diagram: Python ----------
__author__ = "elluis"
__version__ = "2022.07.27"
import rhinoscriptsyntax as rs


#1.b RESULTANT (FORCE DIAGRAM)

#force diagram load line
Lp_loadline=[]
Lp_loadline.append(X)
Ll_loadline=[]
for i in range (0,len(Lv_load)):
    p=rs.CopyObject(X,Lv_load[i])
    l=rs.AddLine(X,p)
    Lp_loadline.append(p)
    Ll_loadline.append(l)
    X=p

#force diagram aux lines
Lal_force=[]
for i in range (0,len(Lp_loadline)):
    al=rs.AddLine(O1,Lp_loadline[i])
    Lal_force.append(al)
# ---------- end _1_b_resultant_force_diagram ----------

# ---- group: right cliff
crv = Curve(<curve referenced from the Rhino model>)  # disabled

crv_2 = Curve(<curve referenced from the Rhino model>)

# ----
curvepoint = PointOnCurve(crv_2, parameter=0.486)
_1_c_resultant_form_diagram = GhPythonScript(
    p_right=curvepoint,
    O1=o1,
    Ll_LOA=_1_a_input_loads.Ll_LOA,
    Lal_force=_1_b_resultant_force_diagram.Lal_force,
    z=Slider(504, range=0..1000))  # -> p_R; inputs Ll_LOA: list, Lal_force: list
# ---------- _1_c_resultant_form_diagram: Python ----------
__author__ = "elluis"
__version__ = "2022.07.27"

import rhinoscriptsyntax as rs

#1.c RESULTANT (FORM DIAGRAM)

#add duplicate of last LOA
Ll_LOA.append(Ll_LOA[-1])

Lal_form=[]
for i in range (0,len(Lal_force)):
    v=rs.VectorCreate(p_right,O1)
    al=rs.CopyObject(Lal_force[i],v)
    ip=rs.LineLineIntersection(al,Ll_LOA[i])
    Lal_form.append(al)
    p_right=ip[0]

ip=rs.LineLineIntersection(Lal_form[0],Lal_form[-1])[0]

#creating the line of action of the resultant
LOA_R=rs.AddLine([ip[0],-1000,0],[ip[0],1000,0])
Lp_LOA_R=rs.DivideCurve(LOA_R,1000)

#choosing the anchor point of the resultant
p_R=Lp_LOA_R[int(z)]

#remove duplicate of last LOA
del Ll_LOA[-1]
# ---------- end _1_c_resultant_form_diagram ----------

# ---- group: right cliff
crv_3 = Curve(crv)  # disabled

# ---- group: left cliff
crv_4 = Curve(<curve referenced from the Rhino model>)  # disabled

# ----
# 2.a Supports
curvepoint_2 = PointOnCurve(crv_4, parameter=0.558)  # disabled
curvepoint_3 = PointOnCurve(crv_3, parameter=0.618)  # disabled

# ---- group: right support
pt_5 = Point(curvepoint_3)  # disabled

# ---- group: left support
pt_6 = Point(curvepoint_2)  # disabled

pt_7 = Point(pt_6)  # disabled

# ---- group: right support
pt_8 = Point(pt_5)  # disabled

# ---- group: right cliff
crv_5 = Curve(crv_2)

# ---- group: left cliff
crv_6 = Curve(<curve referenced from the Rhino model>)

# ----
curvepoint_4 = PointOnCurve(crv_6, parameter=0.122)
curvepoint_5 = PointOnCurve(crv_5, parameter=0.098)
_2_reactions = GhPythonScript(
    sp_left=curvepoint_4,
    sp_right=curvepoint_5,
    p_R=_1_c_resultant_form_diagram,
    Lp_loadline=_1_b_resultant_force_diagram.Lp_loadline)  # -> O2; inputs Lp_loadline: list
# ---------- _2_reactions: Python ----------
__author__ = "elluis"
__version__ = "2022.07.27"

import rhinoscriptsyntax as rs

#2. SUPPORTS AND REACTIONS

#creating lines of reaction forces in form diagram
l1=rs.AddLine(p_R,sp_left)
l2=rs.AddLine(p_R,sp_right)

#building reaction forces in form diagram
v1=rs.VectorCreate(Lp_loadline[-1],p_R)
l1_m=rs.MoveObject(l1,v1)

v2=rs.VectorCreate(Lp_loadline[0],p_R)
l2_m=rs.MoveObject(l2,v2)

O2=rs.LineLineIntersection(l1_m,l2_m)[0]
# ---------- end _2_reactions ----------

# ---- group: right support
pt_9 = Point(pt_5)  # disabled

# ----
_3_internal_forces = GhPythonScript(
    O2=_2_reactions,
    Lp_loadline=_1_b_resultant_force_diagram.Lp_loadline,
    sp_right=curvepoint_5,
    Ll_LOA=_1_a_input_loads.Ll_LOA)  # -> Ll_int_force, Lip_form; inputs Lp_loadline: list, Ll_LOA: list
# ---------- _3_internal_forces: Python ----------
__author__ = "elluis"
__version__ = "2022.07.27"

import rhinoscriptsyntax as rs

#3. INTERNAL FORCES

#creating lines of internal forces in force diagram
Ll_int_force=[]
for i in range (0,len(Lp_loadline)):
    l=rs.AddLine(O2,Lp_loadline[i])
    Ll_int_force.append(l)

#building form diagram of funicular
Lip_form=[]
ap=sp_right
for i in range (0,len(Ll_LOA)):
    v=rs.VectorCreate(ap,O2)
    l=rs.CopyObject(Ll_int_force[i],v)
    ip=rs.LineLineIntersection(l,Ll_LOA[i])
    Lip_form.append(ip[0])
    ap=ip[0]
# ---------- end _3_internal_forces ----------
_4_visualization = GhPythonScript(
    Lp_anc=_1_a_input_loads.Lp_anc,
    Ll_loadline=_1_b_resultant_force_diagram.Ll_loadline,
    sp_left=curvepoint_4,
    sp_right=curvepoint_5,
    Ll_int_force=_3_internal_forces.Ll_int_force,
    Lip_form=_3_internal_forces.Lip_form)  # -> Ll_force, Ll_form; inputs Lp_anc: list, Ll_loadline: list, Ll_int_force: list, Lip_form: list
# ---------- _4_visualization: Python ----------
__author__ = "elluis"
__version__ = "2022.07.27"


import rhinoscriptsyntax as rs

#4. DATA FOR VISUALIZATION

#data for visualization (force diagram)
Ll_force=Ll_loadline+Ll_int_force

#data for visualization (form diagram)
Ll_form1=[]
for i in range (0,len(Lip_form)):
    l=rs.AddLine(Lip_form[i],Lp_anc[i])
    Ll_form1.append(l)

Lip_form.insert(0,sp_right)
Lip_form.append(sp_left)
Ll_form2=[]
for i in range (0,len(Ll_int_force)):
    l=rs.AddLine(Lip_form[i+1],Lip_form[i])
    Ll_form2.append(l)

Ll_form=Ll_form1+Ll_form2
# ---------- end _4_visualization ----------

# ---- group: show pipes
display_pipes = BooleanToggle(True)  # disabled

# ----
ghpython_script = GhPythonScript(Ll_force=_4_visualization.Ll_force, Ll_form=_4_visualization.Ll_form)  # -> Ll_force_ten, Ll_force_com, Lpi_ten, Lpi_com; inputs Ll_force: list, Ll_form: list
# ---------- ghpython_script: Python ----------
__author__ = "elluis"
__version__ = "2022.11.03"

import rhinoscriptsyntax as rs

#5&6. SENSE AND VISUALIZATION

#check angle
Langle=[]
for i in range (0,len(Ll_form)):
    angle=rs.Angle2(Ll_form[i],Ll_force[i])
    Langle.append(round(angle[0]))

#colors in force diagram and pipes in form diagram
x=0.03
Ll_force_ten=[]
Ll_force_com=[]
Lpi_ten=[]
Lpi_com=[]
for i in range (0,len(Ll_form)):
    pi=rs.AddPipe(Ll_form[i],0,x*rs.CurveLength(Ll_force[i]),0,1)
    if Langle[i] ==0:
        Ll_force_ten.append(Ll_force[i])
        Lpi_ten.append(pi[0])
    else:
        Ll_force_com.append(Ll_force[i])
        Lpi_com.append(pi[0])
# ---------- end ghpython_script ----------
# 5.a Sense (tension or compression)
# 6.a Visualization
# 5.b Force magnitude
# 6.b Visualization
# 6.b Visualization
# 6.d Visualization
# 6.d Visualization
# 6.c Pipes
# 6.c Pipes
colour_swatch = ColourSwatch(SwatchColor=RGB(0, 0, 255))
custom_preview = CustomPreview(Geometry=[ghpython_script.Ll_force_ten, ghpython_script.Lpi_ten], Material=ColourSwatch(SwatchColor=RGB(255, 0, 0)))
custom_preview_2 = CustomPreview(Geometry=[ghpython_script.Ll_force_com, ghpython_script.Lpi_com], Material=colour_swatch)

# ---- group: if in compression
colour_swatch_2 = ColourSwatch(SwatchColor=RGB(0, 0, 255))  # disabled

# ---- group: if in tension
colour_swatch_3 = ColourSwatch(SwatchColor=RGB(255, 0, 0))  # disabled

colour_swatch_4 = ColourSwatch(SwatchColor=RGB(255, 0, 0))  # disabled

# ---- group: if in compression
colour_swatch_5 = ColourSwatch(SwatchColor=RGB(0, 0, 255))  # disabled

# ----
# 1.b Resultant (force diagram)
f1_2 = Vector(f1)  # disabled
f2_2 = Vector(f2)  # disabled
line_sdl = LineSDL(Start=pt_3, Direction=f1_2, Length=f1_2)  # disabled
end_points = EndPoints(Curve=line_sdl)  # -> Start, End; disabled
pt_10 = Point(end_points.End)  # disabled
line_sdl_2 = LineSDL(Start=pt_10, Direction=f2_2, Length=f2_2)  # disabled
end_points_2 = EndPoints(Curve=line_sdl_2)  # -> Start, End; disabled
ln = Line(StartPoint=pt_10, EndPoint=_0)  # disabled
line_3 = Line(ln)  # disabled

# ---- group: first point force diagram
pt_11 = Point(end_points.Start)  # disabled

# ---- group: end point force diagram
pt_12 = Point(end_points_2.End)  # disabled

# ----
ln_2 = Line(StartPoint=pt_12, EndPoint=_0)  # disabled
ln_3 = Line(StartPoint=pt_11, EndPoint=_0)  # disabled
line_4 = Line(ln_3)  # disabled
line_5 = Line(ln_2)  # disabled

# ---- group: first point force diagram
pt_13 = Point(pt_11)  # disabled

# ---- group: end point force diagram
pt_14 = Point(pt_12)  # disabled

# ---- group: first point force diagram
pt_15 = Point(pt_11)  # disabled

# ----
# 1.c Resultant (form diagram)
curvepoint_6 = PointOnCurve(crv, parameter=0.499)  # disabled
line_6 = Line(line_4)  # disabled
line_7 = Line(line_3)  # disabled
line_8 = Line(line_5)  # disabled
line_9 = LineSDL(Start=curvepoint_6, Direction=line_6, Length=1)  # disabled
loa_f1_2 = Line(loa_f1)  # disabled
loa_f2_2 = Line(loa_f2)  # disabled
llx = LineLine(Line1=line_9, Line2=loa_f1_2)  # -> ParamA, ParamB, PointA, PointB; disabled
line_10 = LineSDL(Start=llx.PointA, Direction=line_7, Length=1)  # disabled
llx_2 = LineLine(Line1=line_10, Line2=loa_f2_2)  # -> ParamA, ParamB, PointA, PointB; disabled
line_11 = LineSDL(Start=llx_2.PointA, Direction=line_8, Length=1)  # disabled
f1_3 = Vector(unit_y_2)  # disabled
f2_3 = Vector(unit_y)  # disabled
addition = Addition(A=f1_3, B=f2_3)  # disabled

# ---- group: anchor resultant
llx_3 = LineLine(Line1=line_9, Line2=line_11)  # -> ParamA, ParamB, PointA, PointB; disabled

# ----
vector_display_3 = VectorDisplay(Anchor=llx_3.PointA, Vector=addition)  # disabled

# ---- group: anchor resultant
pt_16 = Point(llx_3.PointA)  # disabled

# ----
# 2.b Reactions (form and force diagrams)
ln_4 = Line(StartPoint=pt_16, EndPoint=pt_7)  # disabled
ln_5 = Line(StartPoint=pt_16, EndPoint=pt_8)  # disabled
line_12 = Line(ln_4)  # disabled
line_13 = Line(ln_5)  # disabled
line_14 = LineSDL(Start=pt_14, Direction=line_12, Length=1)  # disabled
line_15 = LineSDL(Start=pt_13, Direction=line_13, Length=1)  # disabled
llx_4 = LineLine(Line1=line_14, Line2=line_15)  # -> ParamA, ParamB, PointA, PointB; disabled
O = Point(llx_4.PointA)  # disabled

# ----
# 3. Internal forces (force and form diagrams)
O_2 = Point(O)  # disabled
pt_17 = Point(pt_10)  # disabled
pt_18 = Point(pt_12)  # disabled
ln_6 = Line(StartPoint=O_2, EndPoint=pt_15)  # disabled
ln_7 = Line(StartPoint=O_2, EndPoint=pt_17)  # disabled
ln_8 = Line(StartPoint=O_2, EndPoint=pt_18)  # disabled
line_16 = Line(ln_6)  # disabled
line_17 = Line(ln_8)  # disabled
line_18 = Line(ln_7)  # disabled
line_19 = LineSDL(Start=pt_9, Direction=line_16, Length=1)  # disabled
loa_f2_3 = Line(loa_f2)  # disabled
loa_f1_3 = Line(loa_f1)  # disabled
llx_5 = LineLine(Line1=line_19, Line2=loa_f1_3)  # -> ParamA, ParamB, PointA, PointB; disabled
line_20 = LineSDL(Start=llx_5.PointA, Direction=line_18, Length=1)  # disabled
llx_6 = LineLine(Line1=line_20, Line2=loa_f2_3)  # -> ParamA, ParamB, PointA, PointB; disabled
pt_19 = Point(llx_5.PointA)  # disabled
pt_20 = Point(llx_6.PointA)  # disabled

line_21 = Line(line_16)  # disabled
line_22 = Line(line_18)  # disabled
line_23 = Line(line_sdl)  # disabled
line_24 = Line(line_sdl_2)  # disabled
line_25 = Line(line_17)  # disabled

right_support = Point(pt_5)  # disabled
anchor_f2 = Point(pt)  # disabled
anchor_f1 = Point(pt_2)  # disabled
left_support = Point(pt_6)  # disabled
pt_21 = Point(pt_19)  # disabled
pt_22 = Point(pt_20)  # disabled
pt_23 = Point(pt_19)  # disabled
pt_24 = Point(pt_20)  # disabled
pt_25 = Point(pt_20)  # disabled
pt_26 = Point(pt_19)  # disabled

# ----
# 4.b Data for visualization (form diagram)
ln_9 = Line(StartPoint=pt_22, EndPoint=anchor_f2)  # disabled
ln_10 = Line(StartPoint=pt_21, EndPoint=anchor_f1)  # disabled
ln_11 = Line(StartPoint=pt_24, EndPoint=pt_26)  # disabled
ln_12 = Line(StartPoint=left_support, EndPoint=pt_25)  # disabled
ln_13 = Line(StartPoint=pt_23, EndPoint=right_support)  # disabled
merge = Merge(Data1=ln_10, Data2=ln_9, Data3=ln_13, Data4=ln_11, Data5=ln_12)  # disabled
line_26 = Line(merge)  # disabled

# ----
# 4.a Data for visualization (force diagram)
merge_2 = Merge(Data1=line_23, Data2=line_24, Data3=line_21, Data4=line_22, Data5=line_25)  # disabled
flatten = FlattenTree(Tree=merge_2, Path="{0}")  # disabled
line_27 = Line(flatten)  # disabled

# ---- group: form diagram all edges
line_28 = Line(line_26)  # disabled

# ---- group: force diagram all edges
line_29 = Line(line_27)  # disabled

line_30 = Line(line_27)  # disabled

# ----
# 5.a Sense (tension or compression)
angle = Angle(VectorA=line_28, VectorB=line_29)  # -> Angle, Reflex; disabled
degrees = Degrees(Radians=angle.Angle)  # disabled
round = Round(Number=degrees)  # -> Nearest, Floor, Ceiling; disabled
equality = Equality(FirstNumber=round.Nearest, SecondNumber=0)  # -> Equality, Inequality; disabled
panel = Panel("compression")  # disabled
panel_2 = Panel("tension")  # disabled
weave = Weave(Pattern=graft(equality.Equality), Stream0=panel, Stream1=panel_2, NullGaps=False)  # -> flatten(Weave); disabled
panel_3 = Panel(weave)  # disabled

# ----
# 5.b Force magnitude
length = Length(Curve=line_30)  # disabled

# ---- group: force magnitude in egde
number = Number(length)  # disabled

# ---- group: form
line_31 = Line(line_28)  # disabled

# ---- group: force magnitude in egde
number_2 = Number(number)  # disabled

# ----
# 6.c Pipes
scale_factor_for_pipes = Panel("30")  # disabled
division = Division(A=number_2, B=scale_factor_for_pipes)  # disabled
pipe = Pipe(Curve=line_31, Radius=division, Caps=1)  # -> flatten(Pipe); disabled
dispatch = Dispatch(List=pipe, DispatchPattern=display_pipes)  # -> ListA, ListB; disabled

# ---- group: tension / compression
boolean = Boolean(equality.Equality)  # disabled

# ---- group: form pipes
geometry = Geometry(dispatch.ListA)  # disabled

# ---- group: force
line_32 = Line(line_29)  # disabled

# ---- group: force diagram all edges
line_33 = Line(line_29)  # disabled

# ---- group: form diagram all edges
line_34 = Line(line_28)  # disabled

# ---- group: force magnitude in egde
number_3 = Number(number)  # disabled

# ---- group: tension/ compression
boolean_2 = Boolean(boolean)  # disabled

# ---- group: form
line_35 = Line(line_28)  # disabled

# ---- group: form pipes
geometry_2 = Geometry(geometry)  # disabled

# ---- group: tension/ compression
boolean_3 = Boolean(boolean)  # disabled

# ----
# 6.a Visualization
entwine = Entwine(Branch00=line_33, Branch01=line_34, FlattenInputs=True)  # disabled
point_on_curve = PointOnCurve(entwine, parameter=0.414)  # disabled
text_tag_3d = TextTag3D(Location=point_on_curve, Text=number_3, Size=0.7, Justification=5)  # disabled

# ----
# 6.d Visualization
entwine_2 = Entwine(Branch00=line_35, Branch01=geometry_2, FlattenInputs=True)  # disabled
weave_2 = Weave(Pattern=graft(boolean_3), Stream0=colour_swatch_5, Stream1=colour_swatch_4, NullGaps=False)  # -> flatten(Weave); disabled
custom_preview_3 = CustomPreview(Geometry=entwine_2, Shader=weave_2)  # disabled

# ----
# 6.b Visualization
weave_3 = Weave(Pattern=graft(boolean_2), Stream0=colour_swatch_2, Stream1=colour_swatch_3, NullGaps=False)  # -> flatten(Weave); disabled
end_points_3 = EndPoints(Curve=line_32)  # -> Start, End; disabled
vector_display_ex = VectorDisplayEx(Point=end_points_3.Start, Vector=line_32, Colour=weave_3, Width=2)  # disabled
