# Grasshopper definition CSDI_II_tutorial.gh (Grasshopper 1.0.7)

# ---- group: anchor F2
point = Point(<point referenced from the Rhino model>)

# ---- group: anchor F1
point_2 = Point(<point referenced from the Rhino model>)

# ----
# 1.a Input loads
number_slider = Slider(-12, range=-50..50)
unit_y = UnitY(Factor=number_slider)
unit_y_2 = UnitY(Factor=Slider(-7, range=-50..50))
vector_display = VectorDisplay(Anchor=point, Vector=unit_y)
vector_display_2 = VectorDisplay(Anchor=point_2, Vector=unit_y_2)
f2 = Vector(unit_y)
f1 = Vector(unit_y_2)
line_sdl = LineSDL(Start=point, Direction=f2, Length=1)
line_sdl_2 = LineSDL(Start=point_2, Direction=f1, Length=1)
loa_f1 = Line(line_sdl_2)
loa_f2 = Line(line_sdl)

# ---- group: first point force diagram
point_3 = Point(Point(34.74034225, 18.30244348, 0))

# ---- group: I'm random!
_0 = Point(<point referenced from the Rhino model>)

# ---- group: right cliff
curve = Curve(<curve referenced from the Rhino model>)

# ---- group: left cliff
curve_2 = Curve(<curve referenced from the Rhino model>)

# ---- group: right cliff
curve_3 = Curve(curve)

# ----
# 2.a Supports
point_on_curve = PointOnCurve(curve_2, parameter=0.771)
point_on_curve_2 = PointOnCurve(curve_3, parameter=0.625)

# ---- group: right support
point_4 = Point(point_on_curve_2)

# ---- group: left support
point_5 = Point(point_on_curve)

point_6 = Point(point_5)

# ---- group: right support
point_7 = Point(point_4)

point_8 = Point(point_4)

# ---- group: show pipes
display_pipes = BooleanToggle(True)

# ---- group: if in compression
colour_swatch = ColourSwatch(SwatchColor=RGB(0, 0, 255))

# ---- group: if in tension
colour_swatch_2 = ColourSwatch(SwatchColor=RGB(255, 0, 0))

colour_swatch_3 = ColourSwatch(SwatchColor=RGB(255, 0, 0))

# ---- group: if in compression
colour_swatch_4 = ColourSwatch(SwatchColor=RGB(0, 0, 255))

# ----
# 1.b Resultant (force diagram)
f1_2 = Vector(f1)
f2_2 = Vector(f2)
line_sdl_3 = LineSDL(Start=point_3, Direction=f1_2, Length=f1_2)
end_points = EndPoints(Curve=line_sdl_3)  # -> Start, End
point_9 = Point(end_points.End)
line_sdl_4 = LineSDL(Start=point_9, Direction=f2_2, Length=f2_2)
end_points_2 = EndPoints(Curve=line_sdl_4)  # -> Start, End
line = Line(StartPoint=point_9, EndPoint=_0)
line_2 = Line(line)

# ---- group: first point force diagram
point_10 = Point(end_points.Start)

# ---- group: end point force diagram
point_11 = Point(end_points_2.End)

# ----
line_3 = Line(StartPoint=point_11, EndPoint=_0)
line_4 = Line(StartPoint=point_10, EndPoint=_0)
line_5 = Line(line_3)
line_6 = Line(line_4)

# ---- group: first point force diagram
point_12 = Point(point_10)

# ---- group: end point force diagram
point_13 = Point(point_11)

# ---- group: first point force diagram
point_14 = Point(point_10)

# ----
# 1.c Resultant (form diagram)
point_on_curve_3 = PointOnCurve(curve, parameter=0.535)
line_7 = Line(line_6)
line_8 = Line(line_2)
line_9 = Line(line_5)
line_sdl_5 = LineSDL(Start=point_on_curve_3, Direction=line_7, Length=1)
loa_f1_2 = Line(loa_f1)
loa_f2_2 = Line(loa_f2)
line_line = LineLine(Line1=line_sdl_5, Line2=loa_f1_2)  # -> ParamA, ParamB, PointA, PointB
line_sdl_6 = LineSDL(Start=line_line.PointA, Direction=line_8, Length=1)
line_line_2 = LineLine(Line1=line_sdl_6, Line2=loa_f2_2)  # -> ParamA, ParamB, PointA, PointB
line_sdl_7 = LineSDL(Start=line_line_2.PointA, Direction=line_9, Length=1)
f1_3 = Vector(unit_y_2)
f2_3 = Vector(unit_y)
addition = Addition(A=f1_3, B=f2_3)

# ---- group: anchor resultant
line_line_3 = LineLine(Line1=line_sdl_5, Line2=line_sdl_7)  # -> ParamA, ParamB, PointA, PointB

# ----
vector_display_3 = VectorDisplay(Anchor=line_line_3.PointA, Vector=addition)

# ---- group: anchor resultant
point_15 = Point(line_line_3.PointA)

# ----
# 2.b Reactions (form and force diagrams)
line_10 = Line(StartPoint=point_15, EndPoint=point_6)
line_11 = Line(StartPoint=point_15, EndPoint=point_7)
line_12 = Line(line_10)
line_13 = Line(line_11)
line_sdl_8 = LineSDL(Start=point_13, Direction=line_12, Length=1)
line_sdl_9 = LineSDL(Start=point_12, Direction=line_13, Length=1)
line_line_4 = LineLine(Line1=line_sdl_8, Line2=line_sdl_9)  # -> ParamA, ParamB, PointA, PointB
O = Point(line_line_4.PointA)

# ----
# 3. Internal forces (force and form diagrams)
O_2 = Point(O)
point_16 = Point(point_9)
point_17 = Point(point_11)
line_14 = Line(StartPoint=O_2, EndPoint=point_14)
line_15 = Line(StartPoint=O_2, EndPoint=point_16)
line_16 = Line(StartPoint=O_2, EndPoint=point_17)
line_17 = Line(line_14)
line_18 = Line(line_16)
line_19 = Line(line_15)
line_sdl_10 = LineSDL(Start=point_8, Direction=line_17, Length=1)
loa_f2_3 = Line(loa_f2)
loa_f1_3 = Line(loa_f1)
line_line_5 = LineLine(Line1=line_sdl_10, Line2=loa_f1_3)  # -> ParamA, ParamB, PointA, PointB
line_sdl_11 = LineSDL(Start=line_line_5.PointA, Direction=line_19, Length=1)
line_line_6 = LineLine(Line1=line_sdl_11, Line2=loa_f2_3)  # -> ParamA, ParamB, PointA, PointB
point_18 = Point(line_line_5.PointA)
point_19 = Point(line_line_6.PointA)

line_20 = Line(line_sdl_4)
line_21 = Line(line_17)
line_22 = Line(line_19)
line_23 = Line(line_sdl_3)
line_24 = Line(line_18)

right_support = Point(point_4)
anchor_f2 = Point(point)
anchor_f1 = Point(point_2)
point_20 = Point(point_18)
point_21 = Point(point_19)
left_support = Point(point_5)
point_22 = Point(point_18)
point_23 = Point(point_19)
point_24 = Point(point_19)
point_25 = Point(point_18)

# ----
# 4.b Data for visualization (form diagram)
line_25 = Line(StartPoint=point_21, EndPoint=anchor_f2)
line_26 = Line(StartPoint=point_20, EndPoint=anchor_f1)
line_27 = Line(StartPoint=point_23, EndPoint=point_25)
line_28 = Line(StartPoint=left_support, EndPoint=point_24)
line_29 = Line(StartPoint=point_22, EndPoint=right_support)
merge = Merge(Data1=line_26, Data2=line_25, Data3=line_29, Data4=line_27, Data5=line_28)
line_30 = Line(merge)

# ----
# 4.a Data for visualization (force diagram)
merge_2 = Merge(Data1=line_23, Data2=line_20, Data3=line_21, Data4=line_22, Data5=line_24)
flatten_tree = FlattenTree(Tree=merge_2, Path="{0}")
line_31 = Line(flatten_tree)

# ---- group: form diagram all edges
line_32 = Line(line_30)

# ---- group: force diagram all edges
line_33 = Line(line_31)

line_34 = Line(line_31)

# ----
# 5.a Sense (tension or compression)
angle = Angle(VectorA=line_32, VectorB=line_33)  # -> Angle, Reflex
degrees = Degrees(Radians=angle.Angle)
round = Round(Number=degrees)  # -> Nearest, Floor, Ceiling
equality = Equality(FirstNumber=round.Nearest, SecondNumber=0)  # -> Equality, Inequality
weave = Weave(Pattern=graft(equality.Equality), Stream0="compression", Stream1="tension", NullGaps=False)  # -> flatten(Weave)
panel = Panel(weave)

# ----
# 5.b Force magnitude
length = Length(Curve=line_34)

# ---- group: force magnitude in egde
number = Number(length)

# ---- group: form
line_35 = Line(line_32)

# ---- group: force magnitude in egde
number_2 = Number(number)

# ----
# 6.c Pipes
scale_factor_for_pipes = Panel("30")
division = Division(A=number_2, B=scale_factor_for_pipes)
pipe = Pipe(Curve=line_35, Radius=division, Caps=1)  # -> flatten(Pipe)
dispatch = Dispatch(List=pipe, DispatchPattern=display_pipes)  # -> ListA, ListB

# ---- group: tension / compression
boolean = Boolean(equality.Equality)

# ---- group: form pipes
geometry = Geometry(dispatch.ListA)

# ---- group: force diagram all edges
line_36 = Line(line_33)

# ---- group: force
line_37 = Line(line_33)

# ---- group: form diagram all edges
line_38 = Line(line_32)

# ---- group: tension/ compression
boolean_2 = Boolean(boolean)

# ---- group: force magnitude in egde
number_3 = Number(number)

# ---- group: form
line_39 = Line(line_32)

# ---- group: tension/ compression
boolean_3 = Boolean(boolean)

# ---- group: form pipes
geometry_2 = Geometry(geometry)

# ----
# 6.a Visualization
entwine = Entwine(Branch00=line_36, Branch01=line_38, FlattenInputs=True)
point_on_curve_4 = PointOnCurve(entwine, parameter=0.5)
text_tag_3d = TextTag3D(Location=point_on_curve_4, Text=number_3, Size=0.7, Justification=5)

# ----
# 6.d Visualization
entwine_2 = Entwine(Branch00=line_39, Branch01=geometry_2, FlattenInputs=True)
weave_2 = Weave(Pattern=graft(boolean_3), Stream0=colour_swatch_4, Stream1=colour_swatch_3, NullGaps=False)  # -> flatten(Weave)
custom_preview = CustomPreview(Geometry=entwine_2, Shader=weave_2)

# ----
# 6.b Visualization
weave_3 = Weave(Pattern=graft(boolean_2), Stream0=colour_swatch, Stream1=colour_swatch_2, NullGaps=False)  # -> flatten(Weave)
end_points_3 = EndPoints(Curve=line_37)  # -> Start, End
vector_display_ex = VectorDisplayEx(Point=end_points_3.Start, Vector=line_37, Colour=weave_3, Width=2)
