# Grasshopper definition CSDI_I_tutorial.gh (Grasshopper 1.0.7)
# plug-ins: sof_gh_sofistik_rhino

io = IO(
    SofistikDocumentProperties_VersionMajor="2020",
    SofistikDocumentProperties_VersionMinor="10",
    SofistikDocumentProperties_VersionName="Rhino-Interface")

# ---- group: right cliff
left_cliff = Curve(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)

# ----
# 1b. support position
left_cliff_2 = Curve(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)
divide = DivideCurve(Curve=left_cliff_2, Count=20, Kinks=False)  # -> Points, Tangents, Parameters
divide_2 = DivideCurve(Curve=left_cliff, Count=20, Kinks=False)  # -> Points, Tangents, Parameters
item = ListItem(List=divide.Points, Index=Slider(19, range=0..20), Wrap=True)
item_2 = ListItem(List=divide_2.Points, Index=Slider(19, range=0..20), Wrap=True)

# ---- group: force magnitude
number_slider = Slider(-15, range=-30..0)

# ---- group: nodal height
number_slider_2 = Slider(5.4, range=-10..10)

# ---- group: bridge anchor point
point = Point(Point(-0.07882131345, -0.25, 0))

# ----
# 1a. nodal position
unit_y = UnitY(Factor=number_slider_2)
move = Move(Geometry=point, Motion=unit_y)  # -> Geometry, Transform
node_location = Point(move.Geometry)

# ---- group: bridge anchor point
point_2 = Point(point)

# ----
# 1.c input load
unit_y_2 = UnitY(Factor=number_slider)
vector_display = VectorDisplay(Anchor=point_2, Vector=unit_y_2)

# ---- group: left support point
pt = Point(item)

# ---- group: right support point
pt_2 = Point(item_2)

# ---- group: force vector
vector = Vector(unit_y_2)

# ---- group: bridge anchor point
point_3 = Point(point)

# ---- group: left support point
pt_3 = Point(pt)

# ---- group: right support point
pt_4 = Point(pt_2)

# ---- group: force diagram location
point_4 = Point(Point(22, 14, 0))

# ---- group: force vector
vector_2 = Vector(vector)

# ---- group: center edge
line_sdl = LineSDL(Start=point_4, Direction=vector_2, Length=vector_2)

line = Line(line_sdl)

# ---- group: show pipes
display_pipes = BooleanToggle(True)

# ---- group: if in compression
colour_swatch = ColourSwatch(SwatchColor=RGB(0, 0, 255))

# ---- group: if in tension
colour_swatch_2 = ColourSwatch(SwatchColor=RGB(255, 0, 0))

colour_swatch_3 = ColourSwatch(SwatchColor=RGBA(255, 0, 0, 150))

# ---- group: if in compression
colour_swatch_4 = ColourSwatch(SwatchColor=RGBA(0, 0, 255, 150))

# ----
# 2. form diagram
# by definition: edge orientation away from the node!
node_location_2 = Point(node_location)
ln = Line(StartPoint=node_location_2, EndPoint=point_3)
ln_2 = Line(StartPoint=node_location_2, EndPoint=pt_3)
ln_3 = Line(StartPoint=node_location_2, EndPoint=pt_4)

# ---- group: center edge
line_2 = Line(ln)

# ---- group: left edge
line_3 = Line(ln_2)

# ---- group: right edge
line_4 = Line(ln_3)

# ----
merge = Merge(Data1=line_2, Data2=line_3, Data3=line_4)  # -> flatten(Result)

# ---- group: form diagram all edges
line_5 = Line(merge)

# ---- group: left edge
vector_3 = Vector(line_3)

# ---- group: right edge
vector_4 = Vector(line_4)

# ---- group: form diagram all edges
line_6 = Line(line_5)

# ---- group: form
line_7 = Line(line_6)

# ---- group: form diagram all edges
line_8 = Line(line_6)

# ---- group: form
line_9 = Line(line_6)

# ----
# 3. force diagram
# by definition:edge orientation closing the polygon!
# by definition: clockwise order of lines!
end_points = EndPoints(Curve=line_sdl)  # -> Start, End

# ---- group: 1. left element direction
line_sdl_2 = LineSDL(Start=end_points.End, Direction=vector_3, Length=3)

# ---- group: 2. right element direction
line_sdl_3 = LineSDL(Start=end_points.Start, Direction=vector_4, Length=3)

# ---- group: intersection event
line_line = LineLine(Line1=line_sdl_2, Line2=line_sdl_3)  # -> ParamA, ParamB, PointA, PointB

# ---- group: pole
pt_5 = Point(line_line.PointA)

# ---- group: left element force
line_10 = Line(StartPoint=end_points.End, EndPoint=pt_5)

# ---- group: right element force
line_11 = Line(StartPoint=pt_5, EndPoint=end_points.Start)

# ---- group: right edge
line_12 = Line(line_11)

# ---- group: left edge
line_13 = Line(line_10)

# ----
merge_2 = Merge(Data1=line, Data2=line_13, Data3=line_12)  # -> flatten(Result)

# ---- group: force diagram all edges
line_14 = Line(merge_2)

line_15 = Line(line_14)

line_16 = Line(line_14)

# ----
# 4.b force magnitude
length = Length(Curve=line_15)
expression = Expression(x=length, Expression="round(x, 2)")

# ----
# False = compression
# True = tension
# 4.a sense (tension or compression)
# if 0 degree same direction and if 180 degree opposite direction
angle = Angle(VectorA=line_6, VectorB=line_16)  # -> Angle, Reflex
degrees = Degrees(Radians=angle.Angle)
round = Round(Number=degrees)  # -> Nearest, Floor, Ceiling
equality = Equality(FirstNumber=round.Nearest, SecondNumber=0)  # -> Equality, Inequality
weave = Weave(Pattern=graft(equality.Equality), Stream0="compression", Stream1="tension", NullGaps=False)  # -> flatten(Weave)
panel = Panel(weave)

# ---- group: force magnitude in edges
number = Number(expression)

# ---- group: force magnitude in egde
number_2 = Number(number)

# ----
# pipes in form diagram
scale_factor_for_pipes = Panel("30")
division = Division(A=number_2, B=scale_factor_for_pipes)
pipe = Pipe(Curve=line_7, Radius=division, Caps=1)  # -> flatten(Pipe)
dispatch = Dispatch(List=pipe, DispatchPattern=display_pipes)  # -> ListA, ListB

# ---- group: tension / compression
boolean = Boolean(equality.Equality)

# ---- group: form pipes
geometry = Geometry(dispatch.ListA)

# ---- group: force diagram all edges
line_17 = Line(line_16)

# ---- group: force magnitude in egde
number_3 = Number(number)

# ---- group: form pipes
geometry_2 = Geometry(geometry)

# ---- group: force
line_18 = Line(line_16)

# ---- group: tension/ compression
boolean_2 = Boolean(boolean)

boolean_3 = Boolean(boolean)

# ----
# 5.a. visualization
# display force magnitude as text in form and force diagram
entwine = Entwine(Branch00=line_17, Branch01=line_8, FlattenInputs=True)
point_on_curve = PointOnCurve(entwine, parameter=0.511)
text_tag_3d = TextTag3D(Location=point_on_curve, Text=number_3, Size=0.7, Justification=5)

# ----
# 5.c. visualization
# display coloured form edges and pipes
entwine_2 = Entwine(Branch00=line_9, Branch01=geometry_2, FlattenInputs=True)
weave_2 = Weave(Pattern=graft(boolean_3), Stream0=colour_swatch_4, Stream1=colour_swatch_3, NullGaps=False)  # -> flatten(Weave)
custom_preview = CustomPreview(Geometry=entwine_2, Shader=weave_2)

# ----
# 5.b. visualization
# display coloured force vectors
end_points_2 = EndPoints(Curve=line_18)  # -> Start, End
weave_3 = Weave(Pattern=graft(boolean_2), Stream0=colour_swatch, Stream1=colour_swatch_2, NullGaps=False)  # -> flatten(Weave)
vector_display_ex = VectorDisplayEx(Point=end_points_2.Start, Vector=line_18, Colour=weave_3, Width=2)
